# Grasshopper definition cloud_.gh (Grasshopper 1.0.7)
# plug-ins: Kangaroo2 Components

# ---- group: RH_IN:number
number_slider = Slider(30, range=0..100)

# ----
number_slider_2 = Slider(5, range=0..100)

# ---- group: RH_IN:height
number_slider_3 = Slider(0.27, range=0..1)

# ----
construct_domain = ConstructDomain(DomainStart=number_slider_3, DomainEnd=Slider(0.89, range=0..10))
rectangle = Rectangle(Plane=PlaneXY(0, 0, 0), XSize=number_slider_2, YSize=number_slider_2, Radius=0)  # -> Rectangle, Length
populate_2d = Populate2D(Region=rectangle.Rectangle, Count=number_slider, Seed=1)
list_length = ListLength(List=populate_2d)
random = Random(Range=list_length, Number=construct_domain, Seed=2)
circle = Circle(Plane=populate_2d, Radius=random)
unit_z = UnitZ(Factor=Slider(8, range=0..10))
region_union = RegionUnion(Curves=circle)
move = Move(Geometry=region_union, Motion=unit_z)  # -> Geometry, Transform
boundary_surfaces = BoundarySurfaces(Edges=move.Geometry)
mesh = Mesh(boundary_surfaces)
unit_z_2 = UnitZ(Factor=1)
nakedvertices = NakedVertices(Mesh=mesh)  # -> ClothedIndex, NakedIndex, ClothedPts, NakedPts
edgelengths = EdgeLengths(Mesh=mesh, LengthFactor=1, Strength=1)
show = Show(G=mesh)
load = Load(Point=nakedvertices.ClothedPts, ForceVector=unit_z_2, Weighting=1)
anchor = Anchor(Point=nakedvertices.NakedPts, Strength=10000)
solver = Solver(GoalObjects=[show, edgelengths, load, anchor], Reset=Button(), Threshold=1e-15, Tolerance=0.01, On=Toggle(True))  # -> I, V, O
explode_tree = ExplodeTree(Data=solver.O)  # -> _0000, _00000

# ---- group: RH_OUT:mesh
mesh_2 = Mesh(explode_tree._0000)

# ----
mesh_edges = MeshEdges(Mesh=mesh_2)  # -> NakedEdges, InteriorEdges, NonManifoldEdges

# ---- group: RH_OUT:edges
curve = Curve([mesh_edges.NakedEdges, mesh_edges.InteriorEdges])
